# Grasshopper definition routing_nearest paths_1.gh (Grasshopper 0.9.76)
# plug-ins: Karamba, Python Interpreter, Human

file_path = FilePath("C:\Users\Darts\Desktop\subham\bike&rail coordinates - Sheet1.csv")
number_slider = Slider(25, range=0..25)
import_coordinates = ImportCoordinates(File=file_path, Separator=",", XIndex=Slider(0, range=0..100), YIndex=Slider(1, range=0..10), ZIndex=2)
pop2d = Populate2D(Region={Plane=PlaneXY(0, 0, 0), Size=Domain2(u=0..20, v=0..10)}, Count=Slider(59, range=0..100), Seed=1)
cps = ClosestPoints(Point=import_coordinates, Cloud=import_coordinates, Count=number_slider)  # -> ClosestPoint, CPIndex, Distance
file_path_2 = FilePath("C:\Users\Darts\Desktop\subham\only staions.csv")
jitter = Jitter(List=import_coordinates, Jitter=1, Seed=number_slider)  # -> Values, Indices
ln = Line(StartPoint=graft(import_coordinates), EndPoint=cps.ClosestPoint)  # -> flatten(Line)
import_coordinates_2 = ImportCoordinates(File=file_path_2, Separator=",", XIndex=Slider(0, range=0..100), YIndex=Slider(1, range=0..10), ZIndex=2)
split = SplitList(List=jitter.Values, Index=number_slider)  # -> ListA, ListB
rdlines = RemoveDuplicateLinesKaramba(Line=ln, LimitDistance=0.005)  # -> OutLine, Info, Indexes
path = FilePath("C:\Users\Darts\Desktop\subham\gd_tools-master\gd_tools_2.py")
split_2 = SplitList(List=split.ListB, Index=number_slider)  # -> ListA, ListB
number_slider_2 = Slider(0, range=0..1)
python = PythonScript(lib_path=path, lines=rdlines.OutLine, origins=split.ListA, destinations=split_2.ListA)  # -> out, edges, edge_traversals, nodes, node_traversals, paths; inputs lines: list of Line, origins: list of Point3d, destinations: list of Point3d
# ---------- python: Python ----------
import Rhino.Geometry as rh

import sys
sys.path.append('\\'.join(lib_path.split('\\')[:-1]))
import gd_tools_2 as gd

#To generate data from the input line geometry first make an empty list to store the data.
line_data = []

# iterate over the ‘lines’ input, using  Rhino Geometry functions to get the necessary data from each line and its end points
for line in lines:
    p_1 = line.ToNurbsCurve().PointAtStart
    p_2 = line.ToNurbsCurve().PointAtEnd
    line_data.append([[p_1.X, p_1.Y, p_1.Z], [p_2.X, p_2.Y, p_2.Z]])

#use the .lines2graph() function of the ‘gd_tools_2b.py’ library to build a graph structure from the lines data
graph = gd.lines2graph(line_data)

# process the origin and destination point information
origins = [[p.X, p.Y, p.Z] for p in origins]
destinations = [[p.X, p.Y, p.Z] for p in destinations]

#create an empty list to store the Polyline geometry of the paths we generate:
paths = []

#loop over the origin and destination points to generate the paths
for i in range(len(origins)):

    origin_node = graph.search_node(origins[i])
    dest_node = graph.search_node(destinations[i])
    
    path_nodes = graph.get_route(origin_node, dest_node)
    

    
    all_points = [rh.Point3d(*n.get_coords()) for n in path_nodes]
    paths.append( rh.PolylineCurve(all_points) )


#For each of the edges, both of its end nodes are first converted to Point3d objects, and then passed into the .Line() function to create the Line geometry.
edges = [rh.Line(rh.Point3d(*e.get_nodes()[0].get_coords()), rh.Point3d(*e.get_nodes()[1].get_coords())) for e in graph.get_edges()]
edge_traversals = [e.get_traversal() for e in graph.get_edges()]

#list comprehensions to get the nodes and store them as a list of Point3d objects and to get the traversals going through the nodes.
nodes = [rh.Point3d(*n.get_coords()) for n in graph.get_nodes()]
node_traversals = [n.get_traversal() for n in graph.get_nodes()]
# ---------- end python ----------
merge = Merge(Data1=split.ListA, Data2=split_2.ListA)  # -> flatten(Result)
dots = DotDisplay(Point=merge, Colour=ColourSwatch(SwatchColor=RGB(171, 150, 150)), Size=Slider(0.002, range=0..0.01))
bnd = Bounds(Numbers=python.node_traversals)
dom = ConstructDomain(DomainStart=Slider(0, range=0..1), DomainEnd=Slider(0.51, range=0..1))
bnd_2 = Bounds(Numbers=python.edge_traversals)
dom_2 = ConstructDomain(DomainStart=Slider(1.1, range=0..10), DomainEnd=Slider(4, range=0..10))
previewlw = CustomPreviewLineweights(Geometry=python.paths, Shader=ColourSwatch(SwatchColor=RGB(0, 0, 0)), Thickness=Slider(0.5, range=0..10), Absolute=False)
remap = RemapNumbers(Value=python.node_traversals, Source=bnd, Target=Domain(0, 1))  # -> Mapped, Clipped
remap_2 = RemapNumbers(Value=python.node_traversals, Source=bnd, Target=dom)  # -> Mapped, Clipped
remap_3 = RemapNumbers(Value=python.edge_traversals, Source=bnd_2, Target=Domain(0, 1))  # -> Mapped, Clipped
remap_4 = RemapNumbers(Value=python.edge_traversals, Source=bnd_2, Target=dom_2)  # -> Mapped, Clipped
pt = Point(python.nodes)
line = Line(python.edges)
gradient = Gradient(LowerLimit=0, UpperLimit=1, Parameter=remap_3.Mapped, stops=[0: RGB(192, 192, 192), 0.339: RGB(255, 0, 0)])
gradient_2 = Gradient(
    LowerLimit=0,
    UpperLimit=1,
    Parameter=remap.Mapped,
    stops=[0: RGB(72, 211, 227), 0: RGB(192, 192, 192), 0: RGB(135, 124, 115), 1: RGB(255, 0, 0)])
previewlw_2 = CustomPreviewLineweights(Geometry=line, Shader=gradient, Thickness=remap_4.Mapped, Absolute=False)
dots_2 = DotDisplay(Point=pt, Colour=gradient_2, Size=remap_2.Mapped)
